# Dynamo graph CSV Table Management.dyn (Dynamo 1.2.1.3083)

file_path = Filename("C:\Users\cbt\Downloads\table 508.4.csv")
fromPath = FileObject(file_path)  # "File.FromPath"
readText = File.ReadText(fromPath)
code_block = CodeBlock()
# ---------- code_block.designscript (2 lines) ----------
"
";
# ----------------------------------------
split = String.Split(readText, code_block)
code_block_2 = CodeBlock { 1; }
dropItems = List.DropItems(list=split, amount=code_block_2)
code_block_3 = CodeBlock(IN=dropItems) { data = Flatten(IN); DataOut = DSCore.List.DropItems(data, 32); 21; Headings = DSCore.List.GetItemAtIndex(data, 0..11); }
watch = Watch(code_block_3.DataOut)
chop = List.Chop(list=code_block_3.DataOut, lengths=code_block_3.out2)

# group: Occupancy
firstItem = List.FirstItem(chop, lacing=Longest)

# group: Is Sprinklered?
boolean = BoolSelector(true)

code_block_4 = CodeBlock { 1; }
dropItems_2 = List.DropItems(list=chop, amount=code_block_4, lacing=Longest)
code_block_5 = CodeBlock { 2; }
chop_2 = List.Chop(list=dropItems_2@@L2, lengths=code_block_5)
transpose = List.Transpose(chop_2@L3)
code_block_6 = CodeBlock(transpose) { DSCore.List.FirstItem(a<1L>); DSCore.List.LastItem(a<1L>); }
if_ = If(test=boolean, true=code_block_6.out0, false=code_block_6.out1)
code_block_7 = CodeBlock(a=firstItem, b=if_)
# ---------- code_block_7.designscript (14 lines) ----------
//Map this to the use of the room you're in.
a;









/*Use this to select the required rating
for the room on the other side of the wall*/;
b;
# ----------------------------------------
