# Dynamo graph LifeSavers Script#0 - Prep and Create Views.dyn (Dynamo 1.2.1.3083)

categories = Categories("Rooms")
all_elements_of_category = ElementsOfCategory(categories)
categories_2 = Categories("Levels")
all_elements_of_category_2 = ElementsOfCategory(categories_2)
code_block = CodeBlock(all_elements_of_category, all_elements_of_category_2)
# ---------- code_block.designscript (18 lines) ----------
RoomElevs =
 DSCore.List.Reverse(DSCore.List.Sort(DSCore.List.UniqueItems(a.GetLocation().Z)));

LevelElevs =
 DSCore.List.Sort(b.GetParameterValueByName("Elevation"));

CoarseBools =
 LevelElevs<1> == RoomElevs<2>;
TRUTH = true;
FineBools =
 DSCore.List.ContainsItem(CoarseBools<1L>, TRUTH<1L>);

DSCore.List.Clean(
 FineBools?
  b:
  null,
 false
);
# ----------------------------------------
byLevel = FloorPlanView.ByLevel(code_block.out5)
type = Custom[Element.Type](element=byLevel)  # Gets the family type of a given element (if applicable).
uniqueItems = List.UniqueItems(type)
code_block_2 = CodeBlock { "LifeSafetyPlans"; }
duplicate = Custom[Springs.ElementType.Duplicate](elementType=uniqueItems, newName=code_block_2)  # Create duplicate element types. If the type exists, it will be appended instead.
code_block_3 = CodeBlock(b=byLevel, a=duplicate) { DSCore.List.FirstItem({b,a}); Flatten(DSCore.List.OfRepeatedItem(a.Id,DSCore.List.Count(b))); }
change_family_type = Custom[Change Family Type](element=code_block_3.out0, typeId=code_block_3.out1)  # Changes family type of a family by passing in an Element and type id of the type we want to change it to.
code_block_4 = CodeBlock(a=code_block_3.out0)
# ---------- code_block_4.designscript (5 lines) ----------
"Life Safety Plan - "+String.Replace(
 a.Name,
 "(1)",
 ""
);
# ----------------------------------------
setName = Custom[Element.SetName](element=change_family_type, name=code_block_4)  # Gets the name of a given Revit element
family_types = FamilyTypes("TB:TB")
code_block_5 = CodeBlock(TB=family_types) { a.Name; "LS"+10+(1..DSCore.List.Count(a)); TB; a; }  # unwired: a
byNameNumberTitleBlockAndView = Sheet.ByNameNumberTitleBlockAndView(sheetName=code_block_5.out0@L1, sheetNumber=code_block_5.out1@L1, titleBlockFamilyType=code_block_5.TB@L1, view=code_block_5.a@L1, lacing=Longest)
code_block_6 = CodeBlock(a=change_family_type) { a[0]; }
code_block_7 = CodeBlock { "Crop Region Visible"; 1; }
setParameterByName = Element.SetParameterByName(element=code_block_6, parameterName=code_block_7.out0, value=code_block_7.out1)
byRoom = Custom[FloorPlan.ByRoom]()  # This node takes input of a Room and creates a Floor Plan View with Crop Box set around that room.; unwired: Room
resizeCropBox = Custom[View.ResizeCropBox]()  # Resizes the bounding box of a given Revit element by the specified amount in X, Y and Z direction. May need to be used in conjunction with a Transaction node.; unwired: amt, view
categories_3 = Categories("Walls")
byCategoryAndView = Archilab.Grimshaw.Selection.Select.ByCategoryAndView(categories_3, code_block_6)
geometry = Element.Geometry(byCategoryAndView)
flatten = Flatten(geometry, lacing=Longest)
byGeometry = BoundingBox.ByGeometry(flatten)
maxPoint = BoundingBox.MaxPoint(byGeometry)
minPoint = BoundingBox.MinPoint(byGeometry)
code_block_8 = CodeBlock(a=maxPoint, b=minPoint) { a.X - b.X; a.Y - b.Y; }
code_block_9 = CodeBlock { "Crop View"; 1; }
setParameterByName_2 = Element.SetParameterByName(element=code_block_6, parameterName=code_block_9.out0, value=code_block_9.out1)
boundingBox = Element.BoundingBox(setParameterByName_2)
maxPoint_2 = BoundingBox.MaxPoint(boundingBox)
minPoint_2 = BoundingBox.MinPoint(boundingBox)
code_block_10 = CodeBlock(a=maxPoint_2, b=minPoint_2) { a.X - b.X; a.Y - b.Y; }
code_block_11 = CodeBlock(a=code_block_8.out0, b=code_block_8.out1, x=code_block_10.out0, y=code_block_10.out1) { a; b; x; y; a/x; b/y; }
