# Dynamo graph Lifesavers #1.dyn (Dynamo 1.3.1.1736)

code_block = CodeBlock { "Select rooms by respective use group"; }
file_path = Filename("graphics\life safety life saver icon large.png")
fromPath = FileObject(file_path)  # "File.FromPath"
readFromFile = Image.ReadFromFile(fromPath)
code_block_2 = CodeBlock { "CIRCULATION"; }
code_block_3 = CodeBlock { "Select Use Groups that will be in the project"; }
boolean = BoolSelector(true)

# group: Get CSV and parse data
string = StringInput("\n")
string_2 = StringInput("\n")
code_block_4 = CodeBlock { "LIFE SAVERS LIFE SAFETY SCRIPT #1"; "SELECT DOWNLOADED CODE FILE"; }
code_block_5 = CodeBlock { "Use Group File"; "Select Downloaded Code File"; }
file_path_2 = Filename("Revit Model\occupant load factors.csv")
ui_filepath_data = Custom[UI.FilePath Data](InputName=code_block_5.out0, DefaulPath=file_path_2, ButtonText=code_block_5.out1)  # Create filepath input for UI.MultipleInputForm ++ . Check out www.data-shapes.net for more infos !
code_block_6 = CodeBlock { true; "https://codes.iccsafe.org/public/document/toc/542/"; "RUN AWAY!!!!"; 700; }
ui_multipleinputform = Custom[UI.MultipleInputForm ++](Description_optional=code_block_4.out0, Logo_optional=readFromFile, ButtonText_optional=code_block_4.out1, Inputs=ui_filepath_data, Toggle=boolean, LinkToHelp_optional=code_block_6.out1, CancelButtonText_optional=code_block_6.out2, MaxHeight_optional=code_block_6.out3, Width_optional=code_block_6.out3)  # Create a form with multiple inputs. see www.data-shapes.net for tutorials and infos!
fromPath_2 = FileObject(ui_multipleinputform.User_Inputs)  # "File.FromPath"
code_block_7 = CodeBlock(CR=string, NL=string_2, data=fromPath_2)
# ---------- code_block_7.designscript (21 lines) ----------
CR;
NL;
String.Replace(
 String.Replace(
  String.ToUpper(
   String.Replace(
    String.Replace(
     File.ReadText(data),
     NL,
     " "
    ),
    ",",
    ""
   )
  ),
  " NET",
  " NET"+CR),
 " GROSS",
 " GROSS"+CR
);
CR;
# ----------------------------------------
split = String.Split(code_block_7.out2, code_block_7.out3)
flatten = Flatten(split)
code_block_8 = CodeBlock { -1; }
dropItems = List.DropItems(list=flatten, amount=code_block_8)
code_block_9 = CodeBlock(A=dropItems) { a = Flatten(A); a; a; a; }
code_block_10 = CodeBlock(a=ui_multipleinputform.Was_Run, b=ui_multipleinputform.Was_Cancelled)
# ---------- code_block_10.designscript (5 lines) ----------
a==true?
 b==false?
  true:
  false:
  false;
# ----------------------------------------

# group: Finds the occupant load factor
code_block_11 = CodeBlock { {" GROSS"," NET"}; }
indexOf = String.IndexOf(string=code_block_9.out2, searchFor=code_block_11, lacing=CrossProduct)
code_block_12 = CodeBlock(a=indexOf)
# ---------- code_block_12.designscript (9 lines) ----------
0;
Flatten(
 DSCore.List.Clean(
  a==-1?
   null:
   a,
  false
  )
 )-3;
# ----------------------------------------
remove = String.Remove(str=code_block_9.out2, startIndex=code_block_12.out0, count=code_block_12.out1)
code_block_13 = CodeBlock(t3=remove)
# ---------- code_block_13.designscript (9 lines) ----------
String.Replace(
  String.Replace(
   t3,
   " GROSS",
   ""
  ),
  " NET",
  ""
 );
# ----------------------------------------
code_block_14 = CodeBlock(code_block_13)
# ---------- code_block_14.designscript (6 lines) ----------
POS = true;
startnum = String.StartsWith(a<1>, "" + (0..9)<2>, false);
test = DSCore.List.ContainsItem(startnum<1L>, POS<1L>);
test == true?
 a:
 String.Remove(a,0,1);
# ----------------------------------------
code_block_15 = CodeBlock(code_block_14.out3)
# ---------- code_block_15.designscript (10 lines) ----------
POS = true;
startnum = String.StartsWith(a<1>, "" + (0..9)<2>, false);
test = DSCore.List.ContainsItem(startnum<1L>, POS<1L>);
LoadFactorString =
 test == true?
  a:
  String.Remove(a,0,1);

LoadFactor =
 String.ToNumber(LoadFactorString);
# ----------------------------------------

# group: Finds the Occupancy Type
code_block_16 = CodeBlock(t3=code_block_9.out0, factor=code_block_15.LoadFactorString)
# ---------- code_block_16.designscript (9 lines) ----------
String.Replace(
 String.Replace(
  String.Replace(t3, " GROSS", ""),
  " NET",
  ""
 ),
 factor,
 ""
);
# ----------------------------------------

# group: Finds the is gross factor
code_block_17 = CodeBlock(t2=code_block_9.out3)
# ---------- code_block_17.designscript (3 lines) ----------
String.Contains(t2, " GROSS", false)?
 1:
 0;
# ----------------------------------------

code_block_18 = CodeBlock(OccupancyType=code_block_16, AreaPerOccupant=code_block_15.LoadFactor, IsGross=code_block_17)
# ---------- code_block_18.designscript (22 lines) ----------
OccupancyType;


















{OccupancyType,
AreaPerOccupant,
IsGross};
# ----------------------------------------
code_block_19 = CodeBlock(IN=code_block_18.out1) { IN[0]; IN; }
transpose = List.Transpose(code_block_19.IN)

# group: Select Use Groups
code_block_20 = CodeBlock { "Use Group"; }
ui_listview_data = Custom[UI.Listview Data](InputName=code_block_20, Keys=code_block_19.out0, Values=transpose)  # Create data for ListView input in UI.MultiInputForm ++ . Check out www.data-shapes.net for more infos.
code_block_21 = CodeBlock { "Cancel"; }
ui_multipleinputform_2 = Custom[UI.MultipleInputForm ++](Description_optional=code_block_3, Logo_optional=readFromFile, Inputs=ui_listview_data, Toggle=code_block_10, CancelButtonText_optional=code_block_21)

code_block_22 = CodeBlock(IN=ui_multipleinputform_2.User_Inputs)
# ---------- code_block_22.designscript (6 lines) ----------
DATA = DSCore.List.Transpose(IN);

t3 = DSCore.List.GetItemAtIndex(IN@-2<1>, 0);

AreaPerOccupant = DSCore.List.GetItemAtIndex(IN@-2<1>, 1);
IsGross = DSCore.List.GetItemAtIndex(IN@-2<1>, 2);
# ----------------------------------------
addItemToEnd = List.AddItemToEnd(item=code_block_2, list=code_block_22.t3)
code_block_23 = CodeBlock(a=ui_multipleinputform_2.Was_Run, b=ui_multipleinputform_2.Was_Cancelled)  # same code as code_block_10

# group: Select Rooms for associated Use Groups
categories = Categories("Rooms")
ui_selectmodelelements_data = Custom[UI.SelectModelElements Data](InputName=addItemToEnd, CategoryFilter=categories)  # Creates a Revit element selection input for UI.MultipleInputForm++ . Check out www.data-shapes.net for more infos!
flatten_2 = Flatten(ui_selectmodelelements_data)
ui_multipleinputform_3 = Custom[UI.MultipleInputForm ++](Description_optional=code_block, Logo_optional=readFromFile, Inputs=flatten_2, Toggle=code_block_23, CancelButtonText_optional=code_block_21)
watch = Watch(ui_multipleinputform_2.User_Inputs)

# group: Set Use Group Parameter
code_block_24 = CodeBlock { "Use Group"; }
count = Count(ui_multipleinputform_3.User_Inputs@L2)
ofRepeatedItem = List.OfRepeatedItem(item=addItemToEnd@L1, amount=count@L1)
setParameterByName = Element.SetParameterByName(element=ui_multipleinputform_3.User_Inputs, parameterName=code_block_24, value=ofRepeatedItem)

# group: Set Occ Load Factor Parameter
code_block_25 = CodeBlock { "Occupancy Load Factor"; }
count_2 = Count(ui_multipleinputform_3.User_Inputs)
ofRepeatedItem_2 = List.OfRepeatedItem(item=code_block_22.AreaPerOccupant@L1, amount=count_2)
setParameterByName_2 = Element.SetParameterByName(element=ui_multipleinputform_3.User_Inputs, parameterName=code_block_25, value=ofRepeatedItem_2)

# group: Set Is Gross Parameter
code_block_26 = CodeBlock { "Is Gross"; }
count_3 = Count(ui_multipleinputform_3.User_Inputs)
ofRepeatedItem_3 = List.OfRepeatedItem(item=code_block_22.IsGross@L1, amount=count_3)
setParameterByName_3 = Element.SetParameterByName(element=ui_multipleinputform_3.User_Inputs, parameterName=code_block_26, value=ofRepeatedItem_3)

categories_2 = Categories("Doors")

# group: Calc and set Occupancy Load parameter
code_block_27 = CodeBlock { "Occupancy Load"; }
code_block_28 = CodeBlock { "Area"; }
getParameterValueByName = Element.GetParameterValueByName(element=ui_multipleinputform_3.User_Inputs, parameterName=code_block_28)
occ_load_code_block = CodeBlock(area=getParameterValueByName, RoomOccLoadFactor=ofRepeatedItem_2) { area/RoomOccLoadFactor; }
ceiling = Math.Ceiling(occ_load_code_block)
setParameterByName_4 = Element.SetParameterByName(element=ui_multipleinputform_3.User_Inputs, parameterName=code_block_27, value=ceiling)

passthrough = Custom[Passthrough](passThrough=categories_2, waitFor=setParameterByName_4)  # Forces a sequential order of execution. The node wired into the output of the Passthrough node will be executed *after* the node wired into the waitFor input (e.g. important for some Revit operations). The value of the passThrough input will be passed on to the node wired into the output port of the Passthrough node.
all_elements_of_category = ElementsOfCategory(passthrough)
select_phase = RevitPhases("New Construction")

# group: Find doors with stair or empty room on either side and set Egress Door
code_block_29 = CodeBlock { "Egress Door"; }
rooms = Custom[Door.Rooms](door=all_elements_of_category, phase=select_phase)  # Gets the rooms that are connected by a given door
create = List.Create(rooms.fromRoom, rooms.toRoom)
transpose_2 = List.Transpose(create)
isEmpty = List.IsEmpty(transpose_2@@L2, lacing=Longest)
code_block_30 = CodeBlock(x=transpose_2) { x.Name; }
code_block_31 = CodeBlock { "Stair"; }
contains = String.Contains(str=code_block_30, searchFor=code_block_31)
create_2 = List.Create(isEmpty, contains)
transpose_3 = List.Transpose(create_2)
flatten_3 = Flatten(transpose_3@L3)
anyTrue = Custom[List.AnyTrue](seq=flatten_3)  # Returns true if any item in a list of booleans is true.
code_block_32 = CodeBlock { true; }
code_block_33 = CodeBlock { false; }
if_ = If(test=anyTrue, true=code_block_32, false=code_block_33)
setParameterByName_5 = Element.SetParameterByName(element=all_elements_of_category, parameterName=code_block_29, value=if_)

code_block_34 = CodeBlock { "Suggested egress doors are highlighted red, remove or select additional doors"; }
code_block_35 = CodeBlock { "Suggesting Egress Doors..."; }
file_path_3 = Filename("Necessary GIFs\morty.gif")
ui_image_data = Custom[UI.Image Data](Image=file_path_3)  # Places an image on UI.MultipleInutForm ++ .
code_block_36 = CodeBlock(a=ui_multipleinputform_3.Was_Run, b=ui_multipleinputform_3.Was_Cancelled)  # same code as code_block_10
ui_multipleinputform_4 = Custom[UI.MultipleInputForm ++](Description_optional=code_block_35, Logo_optional=readFromFile, Inputs=ui_image_data, Toggle=code_block_36)
code_block_37 = CodeBlock(a=ui_multipleinputform_4.Was_Run, b=ui_multipleinputform_4.Was_Cancelled)  # same code as code_block_10

# group: Select Rooms for associated Use Groups
categories_3 = Categories("Doors")
code_block_38 = CodeBlock { {"Select Doors You DON'T Want as Egress","Select Doors You WANT as Egress"}; }
ui_selectmodelelements_data_2 = Custom[UI.SelectModelElements Data](InputName=code_block_38)
flatten_4 = Flatten(ui_selectmodelelements_data_2)
ui_multipleinputform_5 = Custom[UI.MultipleInputForm ++](Description_optional=code_block_34, Logo_optional=readFromFile, Inputs=flatten_4, Toggle=code_block_37, CancelButtonText_optional=code_block_21)

code_block_39 = CodeBlock(IN=ui_multipleinputform_5.User_Inputs) { IN[0]; IN[1]; }
code_block_40 = CodeBlock { "Egress Door"; }
boolean_2 = BoolSelector(true)
setParameterByName_6 = Element.SetParameterByName(element=code_block_39.out1, parameterName=code_block_40, value=boolean_2)

# group: Create View Filter for Egress Doors
activeView = Custom[Springs.Doc.ActiveView](refresh=boolean)  # Selects the current document's active view. Supports more view types than the built-in option. Will be depreciated once the bult in node works with all plan types.
code_block_41 = CodeBlock { "Egress Doors"; }
categories_4 = Categories("Doors")
select_rule_type = RuleTypes("Equals")
code_block_42 = CodeBlock { 1; }
code_block_43 = CodeBlock(IN=all_elements_of_category) { IN[0]; }
code_block_44 = CodeBlock { "Egress Door"; }
parameterByName = Parameter.ParameterByName(element=code_block_43, name=code_block_44)
byRuleType = Revit.Filter.FilterRule.ByRuleType(select_rule_type, code_block_42, parameterByName)
byRules = Revit.Filter.ParameterFilterElement.ByRules(code_block_41, categories_4, byRuleType)
addFilter = View.AddFilter(activeView, byRules)
red = Custom[Color.Red]()  # Returns the colour red.
byProperties = Revit.Filter.OverrideGraphicSettings.ByProperties(red, red, red, red)
boolean_3 = BoolSelector(true)
setFilterOverrides = View.SetFilterOverrides(view=addFilter, parameterFilter=byRules, overrides=byProperties, hide=boolean_3)
battleBIM = Custom[Refresh.BattleBIM]()  # This Custom will refresh entire Dynamo graph; unwired: list

code_block_45 = CodeBlock(a=ui_multipleinputform_4.Was_Run, b=ui_multipleinputform_4.Was_Cancelled)  # same code as code_block_10
code_block_46 = CodeBlock { null; }
if_2 = If(test=code_block_45, false=code_block_46)  # unwired: true
lastItem = List.LastItem(ui_multipleinputform_3.User_Inputs@L3)
boolean_4 = BoolSelector(false)
setParameterByName_7 = Element.SetParameterByName(element=code_block_39.out0, parameterName=code_block_40, value=boolean_4)

# group: Circulation center line
boundaries = Custom[Room.Boundaries](room=lastItem)  # Gets a list of all boundary elements of a given room or area
group_curves = Custom[Group Curves](Curves=boundaries.curves, lacing=CrossProduct)  # This node will take any input of flat list of curves and group them into sublists containing "joinable" curves that is continous curves. They might form closed curves or open curves. Use PolyCurve.ByJoinedCurves to convert output groups of curves into single PolyCurves
byJoinedCurves = PolyCurve.ByJoinedCurves(group_curves, lacing=Longest)
byPatch = Surface.ByPatch(byJoinedCurves)
area = Surface.Area(byPatch)
maximumItem = List.MaximumItem(area)
indexOf_2 = IndexOf(area, maximumItem, lacing=Longest)
getItemAtIndex = List.GetItemAtIndex(list=byPatch, index=indexOf_2, lacing=Longest)
perimeterCurves = Surface.PerimeterCurves(getItemAtIndex)
byJoinedCurves_2 = PolyCurve.ByJoinedCurves(perimeterCurves)
code_block_47 = CodeBlock { -1..-20..-0.1; }
offset = Curve.Offset(curve=byJoinedCurves_2, distance=code_block_47, lacing=CrossProduct)
isNull = Object.IsNull(offset)
boolean_5 = BoolSelector(true)
firstIndexOf = List.FirstIndexOf(list=isNull, item=boolean_5, lacing=Longest)
code_block_48 = CodeBlock(a=firstIndexOf) { a-3; }
getItemAtIndex_2 = List.GetItemAtIndex(list=code_block_47, index=code_block_48)
offset_2 = Curve.Offset(curve=byJoinedCurves_2, distance=getItemAtIndex_2)
explode = Geometry.Explode(offset_2)
endPoint = Curve.EndPoint(explode)
byBestFitThroughPoints = Line.ByBestFitThroughPoints(endPoint)
code_block_49 = CodeBlock { 20; }
straightenXY = Custom[Springs.Line.StraightenXY](line=byBestFitThroughPoints, margin=code_block_49)  # Checks a line's end points for irregularities and corrects them if they are at or below the specified margin. The default margin is 1/5000 of the curve length, which is conservative.
code_block_50 = CodeBlock(s=byJoinedCurves_2) { s; }
doesIntersect = Geometry.DoesIntersect(geometry=code_block_50, other=byBestFitThroughPoints)
code_block_51 = CodeBlock(a=doesIntersect, b=byBestFitThroughPoints)
# ---------- code_block_51.designscript (3 lines) ----------
a==true?
 "We aren't able to generate a curve for the corridors which have been isolated in the view. Please create an egress path manually.":
 b;
# ----------------------------------------
code_block_52 = CodeBlock(a=code_block_51)
# ---------- code_block_52.designscript (13 lines) ----------
DSCore.List.ContainsItem(DSCore.Object.Type(a)=="System.String",true)?
 "We aren't able to generate a curve for the corridors which have been isolated in the view. Please create an egress path manually.":
 null;

CorridorTravelLines =
 DSCore.List.Clean(
  DSCore.Object.Type(a)!="System.String"?
   a:
   null,
  false
 );

CorridorTravelLines.ExtendStart(CorridorTravelLines.Length).ExtendEnd(CorridorTravelLines.Length);
# ----------------------------------------
intersect = Geometry.Intersect(geometry=code_block_50, other=code_block_52.out2)
transpose_4 = List.Transpose(intersect)
code_block_53 = CodeBlock(a=transpose_4) { a[0]; a[1]; }
byStartPointEndPoint = Line.ByStartPointEndPoint(startPoint=code_block_53.out0, endPoint=code_block_53.out1)
flatten_5 = Flatten(byStartPointEndPoint)
family_types = FamilyTypes("EgressPath:Egress Path")
current = Document.Current()
activeView_2 = Document.ActiveView(current)
byCurve = Custom[DetailComponent.ByCurve](curve=flatten_5, familyType=family_types, view=activeView_2, lacing=Longest)  # Places a line-based detail component in a given view
count_4 = List.Count(byStartPointEndPoint, lacing=Longest)
ofRepeatedItem_4 = List.OfRepeatedItem(item=family_types, amount=count_4, lacing=Longest)
flatten_6 = Flatten(ofRepeatedItem_4)
categories_5 = Categories("Rooms")
passthrough_2 = Custom[Passthrough](passThrough=categories_5, waitFor=setParameterByName_7)
current_2 = Document.Current()
activeView_3 = Document.ActiveView(current_2)
byCategoryAndView = Archilab.Grimshaw.Selection.Select.ByCategoryAndView(passthrough_2, activeView_3)
code_block_54 = CodeBlock(a=byCategoryAndView)
# ---------- code_block_54.designscript (8 lines) ----------
DSCore.List.Clean(
 a.GetParameterValueByName("Use Group")=="CIRCULATION"?
  String.Contains(a.Name,"Stair",false)?
   null:
   a:
  null,
 false
);
# ----------------------------------------
